# Grasshopper definition 1 Math.gh (Grasshopper 1.0.7)

# ---- group: I'm also a Domain
panel = Panel("0 to 1")

# ----
panel_2 = Panel("""3
7
2
6
7
2
4""")
panel_3 = Panel("""0.0
0.1
0.2
0.3
0.4
0.5
0.6
0.7
0.8
0.9
1.0""")
panel_4 = Panel("""1
2
3
4
5
6
7
8
9
10""")
construct_domain = ConstructDomain(DomainStart="3", DomainEnd="5.7")
bounds = Bounds(Numbers=panel_2)
mass_addition = MassAddition(Input=panel_4)  # -> Result, PartialResults
addition = Addition(A="1", B="2")
subtraction = Subtraction(A="1", B="2")
multiplication = Multiplication(A="3", B="2")
division = Division(A="1", B="2")
remap_numbers = RemapNumbers(Value=panel_3, Source="0 to 1", Target="3 to 5")  # -> Mapped, Clipped
panel_5 = Panel(bounds)
deconstruct_domain = DeconstructDomain(Domain=construct_domain)  # -> Start, End
panel_6 = Panel(construct_domain)
panel_7 = Panel(addition)
panel_8 = Panel(subtraction)
panel_9 = Panel(multiplication)
panel_10 = Panel(division)
deconstruct_domain_2 = DeconstructDomain(Domain=bounds)  # -> Start, End
panel_11 = Panel(mass_addition.Result)
panel_12 = Panel(mass_addition.PartialResults)
panel_13 = Panel(remap_numbers.Mapped)
panel_14 = Panel(deconstruct_domain.End)
panel_15 = Panel(deconstruct_domain.Start)

# ---- group: I'm the maximum
panel_16 = Panel(deconstruct_domain_2.Start)

# ---- group: I'm the ninimum
panel_17 = Panel(deconstruct_domain_2.End)
